# Grasshopper definition Fin.gh (Grasshopper 1.0.7)
# plug-ins: LunchBox

surface = Surface(<surface referenced from the Rhino model>)
offset_surface = OffsetSurface(Surface=surface, Distance=expr("-x", Slider(2, range=0..100)), Retrim=True)
arc = Arc(Plane=PlaneXY(0, 0, 0), Radius=Slider(100, range=0..1000), Angle=Domain(0, 3.141592654))  # -> Arc, Length
rotate = Rotate(Geometry=arc.Arc, Angle=degrees(Slider(360, range=0..360)), Plane=PlaneXY(0, 0, 0))  # -> Geometry, Transform
triangle_panels_b = TrianglePanelsB(Surface=offset_surface, UDivisions=Slider(23, range=0..100), VDivisions=Slider(32, range=0..100))
end_points = EndPoints(Curve=rotate.Geometry)  # -> Start, End
area = Area(Geometry=triangle_panels_b)  # -> Area, Centroid
line = Line(StartPoint=end_points.Start, EndPoint=end_points.End)
sort_list = SortList(Keys=area.Area)  # -> Keys, ValuesValuesA
larger_than = LargerThan(FirstNumber=area.Area, SecondNumber=Slider(0, range=0..10000))  # -> LargerThan, OrEqualTo
rotate_axis = RotateAxis(Geometry=rotate.Geometry, Angle=expr("-x", degrees(Slider(18, range=0..90))), Axis=line)  # -> Geometry, Transform
cull_pattern = CullPattern(List=triangle_panels_b, CullPattern=larger_than.LargerThan)
evaluate_curve = EvaluateCurve(Curve=reparameterize(rotate_axis.Geometry), Parameter=Slider(1, range=0..1))  # -> Point, Tangent, Angle
panel = Panel(sort_list.Keys)
curve = Curve(cull_pattern)
area_2 = Area(Geometry=cull_pattern)  # -> Area, graft(Centroid)
surface_closest_point = SurfaceClosestPoint(Point=area_2.Centroid, Surface=offset_surface)  # -> Point, UVPoint, Distance
explode = Explode(Curve=curve, Recursive=True)  # -> Segments, Vertices
evaluate_surface = EvaluateSurface(Surface=offset_surface, Point=surface_closest_point.UVPoint)  # -> Point, Normal, UDirection, VDirection, Frame
sphere = Sphere(Base=evaluate_curve.Point, Radius=Slider(4, range=0..100))
area_3 = Area(Geometry=sphere)  # -> Area, Centroid
extrude_point = ExtrudePoint(Base=explode.Segments, Point=area_2.Centroid)
colour_picker = ColourPicker(PickedColour=RGB(252, 227, 3))
line_2 = Line(StartPoint=surface_closest_point.Point, EndPoint=area_3.Centroid)
custom_preview = CustomPreview(Geometry=sphere, Material=colour_picker)
fillet = Fillet(Curve=extrude_point, Radius=Slider(0, range=0..1))
angle = Angle(VectorA=evaluate_surface.Normal, VectorB=line_2)  # -> flatten(Angle), Reflex
pt = PointXYZ(XComponent=0, YComponent=0, ZComponent=0, System=PlaneXY(0, 0, 0))
srf = Surface(<surface referenced from the Rhino model>)
bounds = Bounds(Numbers=angle.Angle)
construct_domain = ConstructDomain(DomainStart=Slider(64, range=0..90), DomainEnd=Slider(12, range=0..90))
boundary_surfaces = BoundarySurfaces(Edges=fillet)
number_slider = Slider(0.2, range=0..1)
remap_numbers = RemapNumbers(Value=angle.Angle, Source=bounds, Target=construct_domain)  # -> graft(Mapped), Clipped
hex = HexagonCells(Surface=srf, UDivisions=Slider(28, range=0..100), VDivisions=Slider(26, range=0..100), TParameter=0.25)  # -> HexagonCells, Centers
contour = Contour(Shape=srf, Point=pt, Direction=Vector(0, 0, 1), Distance=Slider(2, range=0..5))
colour = ColourPicker(PickedColour=RGBA(25, 75, 156, 124))
planar = PlanarSrf(Edges=contour)
crv = Curve(hex.HexagonCells)
Z = UnitZ(Factor=number_slider)
rotate_axis_2 = RotateAxis(Geometry=boundary_surfaces, Angle=degrees(remap_numbers.Mapped), Axis=explode.Segments)  # -> Geometry, Transform
colour_picker_2 = ColourPicker(PickedColour=RGB(158, 90, 54))
extr = Extrude(Base=planar, Direction=Z)
colour_picker_3 = ColourPicker(PickedColour=RGB(112, 94, 94))
custom_preview_2 = CustomPreview(Geometry=rotate_axis_2.Geometry, Material=colour_picker_2)
custom_preview_3 = CustomPreview(Geometry=extr, Material=colour_picker_3)
preview = CustomPreview(Geometry=srf, Shader=colour)
pipe = Pipe(Curve=crv, Radius=number_slider, Caps=0)
curve_2 = Curve(contour)
flatten_tree = FlattenTree(Tree=curve_2, Path="{0}")
list_item = ListItem(List=flatten_tree, Index=0, Wrap=True)
area_4 = Area(Geometry=list_item)  # -> Area, Centroid
scale = Scale(Geometry=list_item, Center=area_4.Centroid, Factor=Slider(3, range=0..100))  # -> Geometry, Transform
unit_y = UnitY(Factor=Slider(3, range=0..10))
rotate_2 = Rotate(Geometry=scale.Geometry, Angle=degrees(Slider(36, range=0..100)), Plane=PlaneXY(0, 0, 0))  # -> Geometry, Transform
negative = Negative(Value=unit_y)
move = Move(Geometry=rotate_2.Geometry, Motion=negative)  # -> Geometry, Transform
boundary_surfaces_2 = BoundarySurfaces(Edges=list_item)
boundary_surfaces_3 = BoundarySurfaces(Edges=move.Geometry)
unit_z = UnitZ(Factor=Slider(3, range=0..10))
solid_difference = SolidDifference(BrepsA=boundary_surfaces_2, BrepsB=boundary_surfaces_3)
negative_2 = Negative(Value=unit_z)
extrude = Extrude(Base=solid_difference, Direction=negative_2)
colour_picker_4 = ColourPicker(PickedColour=RGB(109, 128, 176))
deconstruct_brep = DeconstructBrep(Brep=extrude)  # -> Faces, Edges, Vertices
list_item_2 = ListItem(List=deconstruct_brep.Faces, Index=0, Wrap=True)
list_item_3 = ListItem(List=deconstruct_brep.Faces, Index=Slider(2, range=0..10), Wrap=True)
surface_2 = Surface(list_item_3)
negative_3 = Negative(Value=Slider(0.3, range=0..1))
unit_z_2 = UnitZ(Factor=negative_3)
move_2 = Move(Geometry=surface_2, Motion=unit_z_2)  # -> Geometry, Transform
custom_preview_4 = CustomPreview(Geometry=[move_2.Geometry, surface_2, solid_difference], Material=colour_picker_4)
diagrid_structure = DiagridStructure(Surface=move_2.Geometry, UDivisions=Slider(4, range=0..10), VDivisions=Slider(65, range=0..100), Type=True)  # -> StructureLines, StructureNodes
surface_3 = Surface(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)
pipe_2 = Pipe(Curve=diagrid_structure.StructureLines, Radius=Slider(0.04, range=0..1), Caps=0)
split_brep_multiple = SplitBrepMultiple(Brep=pipe_2, Cutters=surface_3)
offset_surface_2 = OffsetSurface(Surface=list_item_2, Distance=negative_3, Retrim=Toggle(True))
offset_surface_3 = OffsetSurface(Surface=list_item_3, Distance=negative_3, Retrim=True)
colour_picker_5 = ColourPicker(PickedColour=RGB(191, 109, 65))
dispatch = Dispatch(List=split_brep_multiple, DispatchPattern=[True, False])  # -> ListA, ListB
custom_preview_5 = CustomPreview(Geometry=split_brep_multiple, Material=colour_picker_5)
brep = Brep(dispatch.ListA)
