# Grasshopper definition Final.gh (Grasshopper 1.0.7)
# plug-ins: LunchBox, Heliotrope

construct_point = ConstructPoint(XCoordinate="0", YCoordinate="0", ZCoordinate="3")

# ----
# Main From
number_slider = Slider(8, range=0..100)
xy = XYPlane(Origin=construct_point)
number_slider_2 = Slider(6, range=0..10)
division = Division(A=number_slider, B=1.3)
multiplication = Multiplication(A=number_slider_2)
dom = ConstructDomain(DomainStart=Slider(0.1, range=0..1), DomainEnd=Slider(0.9, range=0..1))
subtraction = Subtraction(A=multiplication, B=1)
series = Series(Start=0, Step=Slider(6, range=0..10), Count=number_slider_2)
ellipse = Ellipse(Plane=xy, Radius1=number_slider, Radius2=division)  # -> Ellipse, Focus1, Focus2
Z = UnitZ(Factor=series)
range = Range(Domain=dom, Steps=subtraction)
viewer = ParamViewer(range)
move = Move(Geometry=ellipse.Ellipse, Motion=Z)  # -> Geometry, Transform
graph = GraphMapper(
    range,
    x0=0,
    x1=1,
    y0=0,
    y1=1,
    container_name="Sine",
    Equation_px=[0, 0.5975328684],
    Equation_py=[0.5373075008, 0.3837687373])
area = Area(Geometry=move.Geometry)  # -> Area, Centroid
dom_2 = ConstructDomain(DomainStart=graph, DomainEnd=1)
remap = RemapNumbers(Value=dom_2, Source=Domain(0, 1), Target=Domain(0, 1))  # -> Mapped, Clipped
scale = Scale(Geometry=move.Geometry, Center=area.Centroid, Factor=remap.Clipped)  # -> Geometry, Transform
rotate = Rotate(Geometry=scale.Geometry, Angle=range, Plane=PlaneXY(0, 0, 0))  # -> Geometry, Transform
loft = Loft(Curves=rotate.Geometry, Options={Adjust=False, Closed=False, LoftEnds=0, LoftSimp=0, LoftType=0, Rebuild=10, Refit=0.01})

# ----
# Skin Surface
number_slider_3 = Slider(0.1, range=0..1)
dom_3 = ConstructDomain(DomainStart=Slider(0.8, range=0..1), DomainEnd=number_slider_3)
subcrv = SubCurve(BaseCurve=reparameterize(rotate.Geometry), Domain=dom_3)
neg = Negative(Value=Slider(0.5, range=0..1))
loft_2 = Loft(Curves=subcrv, Options={Adjust=False, Closed=False, LoftEnds=0, LoftSimp=0, LoftType=0, Rebuild=10, Refit=0.01})
offset = OffsetSurface(Surface=loft_2, Distance=neg, Retrim=True)
srf = Surface(offset)

srf_2 = Surface(loft)

# ----
# Pattern
panel = Panel("20")
triangle_panels_b = TrianglePanelsB(Surface=srf, UDivisions=panel, VDivisions="30")
area_2 = Area(Geometry=triangle_panels_b)  # -> Area, Centroid
smaller_than = SmallerThan(FirstNumber=area_2.Area, SecondNumber=Slider(0.6, range=0..0.6))  # -> SmallerThan, OrEqualTo
panel_2 = Panel(area_2.Area)
list_item = ListItem(List=triangle_panels_b, Index=smaller_than.SmallerThan, Wrap=True)
dispatch = Dispatch(List=triangle_panels_b, DispatchPattern=list_item)  # -> ListA, ListB
surface = Surface(dispatch.ListB)

# ----
# Structure
number_slider_4 = Slider(10, range=0..10)
negative = Negative(Value=Slider(0.3, range=0..1))
offset_surface = OffsetSurface(Surface=srf_2, Distance=negative, Retrim=True)
hexagonal_structure = HexagonalStructure(Surface=offset_surface, UDivisions=number_slider_4, VDivisions=Slider(8, range=0..10), AdjustShape=0.3, Type=False)  # -> StructureLines, StructureNodes
pipe = Pipe(Curve=hexagonal_structure.StructureLines, Radius=Slider(0.1, range=0..1), Caps=Toggle(True))

# ----
# Mechanism of sunshade
number_slider_5 = Slider(0.15, range=0..1)
area_3 = Area()  # -> Area, Centroid
solar_arc = SolarArc(
    JulianDay=Slider(90, range=0..100),
    Latitude=Slider(34, range=0..100),
    Longitude=Slider(100, range=0..100),
    North=Vector(0, 1, 0),
    Origin=Point(0, 0, 0),
    ScaleArc=Slider(79, range=0..100),
    ScaleSun=Slider(1, range=0..1),
    Offset=number_slider_5)  # -> SolarArc, Sun, SolarVector, TimeOfDay
unit_x = UnitX(Factor=area_3.Centroid)
move_2 = Move(Geometry=[solar_arc.SolarArc, solar_arc.Sun], Motion=unit_x)  # -> Geometry, Transform
list_item_2 = ListItem(List=move_2.Geometry, Index=0, Wrap=True)  # -> Item, Item1
area_4 = Area()  # -> Area, Centroid
surface_2 = Surface(list_item_2.Item1)
volume = Volume(Geometry=surface_2)  # -> Volume, Centroid
point = Point(volume.Centroid)

bounding_box = BoundingBox(Content=srf, Plane=PlaneXY(0, 0, 0))  # -> Box, Box_2
surface_closest_point = SurfaceClosestPoint()  # -> Point, UVPoint, Distance

# ----
# Storis
cap_holes = CapHoles(Brep=srf_2)
unit_z = UnitZ(Factor=1)
deconstruct_brep = DeconstructBrep(Brep=triangle_panels_b)  # -> Faces, Edges, Vertices
list_item_3 = ListItem(List=flatten(deconstruct_brep.Vertices), Index=0, Wrap=True)  # -> Item, Item1
distance = Distance(PointA=list_item_3.Item, PointB=list_item_3.Item1)
contour = Contour(Shape=cap_holes, Point=Point(0, 0, 0), Direction=unit_z, Distance=distance)
boundary_surfaces = BoundarySurfaces(Edges=contour)
panel_3 = Panel(distance)
offset_surface_2 = OffsetSurface(Surface=boundary_surfaces, Distance=Slider(0.05, range=0..0.1), Retrim=Toggle(True))

deconstruct_brep_2 = DeconstructBrep(Brep=bounding_box.Box)  # -> Faces, Edges, Vertices
curve = Curve(contour)
evaluate_surface = EvaluateSurface(Point=surface_closest_point.UVPoint)  # -> Point, Normal, UDirection, VDirection, Frame
line = Line(StartPoint=evaluate_surface.Point, EndPoint=volume.Centroid)
flatten_tree = FlattenTree(Tree=curve, Path="{0}")
angle = Angle(VectorA=evaluate_surface.Normal, VectorB=line)  # -> flatten(Angle), Reflex
list_item_4 = ListItem(List=flatten_tree, Index=0, Wrap=True)
bounds = Bounds(Numbers=angle.Angle)
area_5 = Area(Geometry=list_item_4)  # -> Area, Centroid
construct_domain = ConstructDomain(DomainStart=Slider(0, range=0..90), DomainEnd=Slider(0, range=0..90))
remap_numbers = RemapNumbers(Value=angle.Angle, Source=bounds, Target=construct_domain)  # -> Mapped, Clipped
scale_2 = Scale(Geometry=list_item_4, Center=area_5.Centroid, Factor=Slider(3, range=0..100))  # -> Geometry, Transform
unit_y = UnitY(Factor=Slider(3, range=0..10))
rotate_2 = Rotate(Geometry=scale_2.Geometry, Angle=degrees(Slider(36, range=0..100)), Plane=PlaneXY(0, 0, 0))  # -> Geometry, Transform
negative_2 = Negative(Value=unit_y)

# ----
# Cull Stories
flatten_tree_2 = FlattenTree(Tree=offset_surface_2, Path="{0}")
list_item_5 = ListItem(List=flatten_tree_2, Index="0", Wrap=True)
list_item_6 = ListItem(List=flatten_tree_2, Index="1", Wrap=True)
item_index = ItemIndex(List=flatten_tree_2, Item=[list_item_5, list_item_6])
cull_index = CullIndex(List=flatten_tree_2, Indices=item_index, Wrap=True)
brep = Brep(cull_index)

# ----
# Lobby Hall
move_3 = Move(Geometry=rotate_2.Geometry, Motion=negative_2)  # -> Geometry, Transform
boundary_surfaces_2 = BoundarySurfaces(Edges=list_item_4)
boundary_surfaces_3 = BoundarySurfaces(Edges=move_3.Geometry)
unit_z_2 = UnitZ(Factor=Slider(3, range=0..10))
solid_difference = SolidDifference(BrepsA=boundary_surfaces_2, BrepsB=boundary_surfaces_3)
negative_3 = Negative(Value=unit_z_2)
extrude = Extrude(Base=solid_difference, Direction=negative_3)
deconstruct_brep_3 = DeconstructBrep(Brep=extrude)  # -> Faces, Edges, Vertices
list_item_7 = ListItem(List=deconstruct_brep_3.Faces, Index=0, Wrap=True)
list_item_8 = ListItem(List=deconstruct_brep_3.Faces, Index=Slider(2, range=0..10), Wrap=True)
surface_3 = Surface(list_item_8)
construct_domain_2 = ConstructDomain(DomainStart=Slider(0, range=0..90), DomainEnd=Slider(0, range=0..90))
negative_4 = Negative(Value=Slider(0.3, range=0..1))
unit_z_3 = UnitZ(Factor=negative_4)
move_4 = Move(Geometry=surface_3, Motion=unit_z_3)  # -> Geometry, Transform
diagrid_structure = DiagridStructure(Surface=move_4.Geometry, UDivisions=Slider(4, range=0..10), VDivisions=Slider(65, range=0..100), Type=True)  # -> StructureLines, StructureNodes
surface_4 = Surface(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)
pipe_2 = Pipe(Curve=diagrid_structure.StructureLines, Radius=Slider(0.04, range=0..1), Caps=0)
split_brep_multiple = SplitBrepMultiple(Brep=pipe_2, Cutters=surface_4)
offset_surface_3 = OffsetSurface(Surface=list_item_7, Distance=negative_4, Retrim=Toggle(True))
offset_surface_4 = OffsetSurface(Surface=list_item_8, Distance=negative_4, Retrim=True)
dispatch_2 = Dispatch(List=split_brep_multiple, DispatchPattern=[True, False])  # -> ListA, ListB
brep_2 = Brep(dispatch_2.ListA)
colour_picker = ColourPicker(PickedColour=RGB(31, 240, 163))
custom_preview = CustomPreview(Material=colour_picker)

arc = Arc(Plane=PlaneXY(0, 0, 0), Radius=Slider(80, range=0..10000), Angle=Domain(0, 3.141592654))  # -> Arc, Length
rotate_3 = Rotate(Geometry=arc.Arc, Angle=degrees(Slider(76, range=0..180)), Plane=PlaneXY(0, 0, 0))  # -> Geometry, Transform
end_points = EndPoints(Curve=rotate_3.Geometry)  # -> Start, End
line_2 = Line(StartPoint=end_points.Start, EndPoint=end_points.End)
rotate_axis = RotateAxis(Geometry=rotate_3.Geometry, Angle=expr("-x", degrees(Slider(36, range=0..90))), Axis=line_2)  # -> Geometry, Transform
evaluate_curve = EvaluateCurve(Curve=reparameterize(rotate_axis.Geometry), Parameter=Slider(0.07, range=0..1))  # -> Point, Tangent, Angle
sphere = Sphere(Base=evaluate_curve.Point, Radius=Slider(6, range=0..100))
area_6 = Area(Geometry=sphere)  # -> Area, Centroid

# ----
# Skin Pattern
area_7 = Area(Geometry=surface)  # -> Area, Centroid
surface_closest_point_2 = SurfaceClosestPoint(Point=area_7.Centroid, Surface=surface)  # -> Point, UVPoint, Distance
md_slider = MDSlider(
    SliderMode=0,
    slider_value=Point(0.3260468274, 0.5583156097, 0.5),
    x_domain=Domain(0, 1),
    y_domain=Domain(0, 1),
    z_domain=Domain(0, 1))
md_slider_2 = MDSlider(
    SliderMode=0,
    slider_value=Point(0.285848478, 0.6637348376, 0.5),
    x_domain=Domain(0, 1),
    y_domain=Domain(0, 1),
    z_domain=Domain(0, 1))
evaluate_surface_2 = EvaluateSurface(Surface=surface, Point=surface_closest_point_2.UVPoint)  # -> Point, Normal, UDirection, VDirection, Frame
amplitude = Amplitude(Vector=evaluate_surface_2.Normal, Amplitude=Slider(0, range=0..1))
evaluate_surface_3 = EvaluateSurface(Surface=reparameterize(deconstruct_brep_2.Faces), Point=[md_slider_2, md_slider])  # -> Point, Normal, UDirection, VDirection, Frame
negative_5 = Negative(Value=amplitude)
move_5 = Move(Geometry=area_7.Centroid, Motion=negative_5)  # -> Geometry, Transform
construct_domain_3 = ConstructDomain(DomainStart=Slider(1, range=0..1), DomainEnd=Slider(0, range=0..1))
closest_point = ClosestPoint(Point=evaluate_surface_3.Point, Cloud=area_7.Centroid)  # -> ClosestPoint, CPIndex, Distance
extrude_point = ExtrudePoint(Base=surface, Point=move_5.Geometry)
bounds_2 = Bounds(Numbers=closest_point.Distance)
graft_tree = GraftTree(Tree=extrude_point, IncludeEmptyLists=True, IncludeNullItems=True)
remap_numbers_2 = RemapNumbers(Value=closest_point.Distance, Source=bounds_2, Target=construct_domain_3)  # -> Mapped, Clipped
list_item_9 = ListItem(List=graft_tree, Index=Slider(140, range=0..1000), Wrap=True)
graph_mapper = GraphMapper(
    remap_numbers_2.Clipped,
    x0=0,
    x1=1,
    y0=0,
    y1=1,
    container_name="Sine",
    Equation_px=[0, 0.2217398435],
    Equation_py=[0, 0.7956525087])
deconstruct_brep_4 = DeconstructBrep(Brep=list_item_9)  # -> Faces, Edges, Vertices
list_item_10 = ListItem(List=deconstruct_brep_4.Faces, Index=0, Wrap=True)  # -> Item, Item1, Item2, Item3
graft_tree_2 = GraftTree(Tree=graph_mapper, IncludeEmptyLists=True, IncludeNullItems=True)
param_viewer = ParamViewer(graft_tree_2)
surface_5 = Surface(list_item_10.Item1)
surface_6 = Surface(list_item_10.Item3)
surface_7 = Surface(list_item_10.Item2)
deconstruct_brep_5 = DeconstructBrep(Brep=surface_5)  # -> Faces, Edges, Vertices
deconstruct_brep_6 = DeconstructBrep(Brep=surface_7)  # -> Faces, Edges, Vertices
deconstruct_brep_7 = DeconstructBrep(Brep=surface_6)  # -> Faces, Edges, Vertices
number_slider_6 = Slider(0, range=0..100)
list_item_11 = ListItem(List=deconstruct_brep_5.Edges, Index=0, Wrap=True)
list_item_12 = ListItem(List=deconstruct_brep_6.Edges, Index=0, Wrap=True)
list_item_13 = ListItem(List=deconstruct_brep_7.Edges, Index=0, Wrap=True)

surface_closest_point_3 = SurfaceClosestPoint(Point=area_7.Centroid, Surface=srf)  # -> Point, UVPoint, Distance
evaluate_surface_4 = EvaluateSurface(Surface=srf, Point=surface_closest_point_3.UVPoint)  # -> Point, Normal, UDirection, VDirection, Frame
line_3 = Line(StartPoint=surface_closest_point_3.Point, EndPoint=area_6.Centroid)

angle_2 = Angle(VectorA=evaluate_surface_4.Normal, VectorB=line_3)  # -> flatten(Angle), Reflex
bounds_3 = Bounds(Numbers=angle_2.Angle)
remap_numbers_3 = RemapNumbers(Value=angle_2.Angle, Source=bounds_3, Target=construct_domain_2)  # -> graft(Mapped), Clipped
rotate_axis_2 = RotateAxis(Angle=degrees(remap_numbers_3.Mapped), Axis=Line((0, 0, 0), (10, 0, 0)))  # -> Geometry, Transform

rotate_axis_3 = RotateAxis(Geometry=surface_5, Angle=graft_tree_2, Axis=list_item_11)  # -> Geometry, Transform
rotate_axis_4 = RotateAxis(Geometry=surface_6, Angle=graft_tree_2, Axis=list_item_13)  # -> Geometry, Transform
rotate_axis_5 = RotateAxis(Geometry=surface_7, Angle=graft_tree_2, Axis=list_item_12)  # -> Geometry, Transform

param_viewer_2 = ParamViewer(rotate_axis_3.Geometry)
merge = Merge(Data1=rotate_axis_3.Geometry, Data2=rotate_axis_5.Geometry, Data3=rotate_axis_4.Geometry)
brep_join = BrepJoin(Breps=merge)  # -> Breps, Closed
